# Grasshopper definition example-rhino6 (1).gh (Grasshopper 1.0.7)

c = Slider(147.52, range=0..200)
# www.parametrichouse.com
a = Slider(0, range=0..200)
b = Slider(73.42, range=0..200)
c_2 = Slider(53.44, range=0..100)
a_2 = Slider(45.91, range=0..100)
b_2 = Slider(23.45, range=0..100)
construct_point = ConstructPoint(XCoordinate=0, YCoordinate=0, ZCoordinate=[a, b, c])
circle = Circle(Plane=construct_point, Radius=[a_2, b_2, c_2])
list_item = ListItem(List=circle, Index=0, Wrap=True)  # -> Item, Item1, Item2
divide_curve = DivideCurve(Curve=circle, Count=Slider(21, range=4..35), Kinks=False)  # -> Points, Tangents, Parameters
flip_matrix = FlipMatrix(Data=divide_curve.Points)
curve = Curve(list_item.Item1)
interpolate = Interpolate(Vertices=flip_matrix, Degree=3, Periodic=False, KnotStyle=1)  # -> simplify(Curve), Length, Domain
rotate_3d = Rotate3D(Geometry=curve, Angle=degrees(Slider(1, range=0..1)), Center=Point(0, 0, 0), Axis=Vector(0, 0, 1))  # -> Geometry, Transform
curve_curve = CurveCurve(CurveA=reparameterize(interpolate.Curve), CurveB=curve)  # -> Points, ParamsA, ParamsB
horizontal_frame = HorizontalFrame(Curve=reparameterize(interpolate.Curve), Parameter=Slider(1, range=0..1))
horizontal_frame_2 = HorizontalFrame(Curve=reparameterize(interpolate.Curve), Parameter=Slider(0, range=0..1))
horizontal_frame_3 = HorizontalFrame(Curve=reparameterize(interpolate.Curve), Parameter=curve_curve.ParamsA)
deconstruct_plane = DeconstructPlane(Plane=horizontal_frame_2)  # -> Origin, XAxis, YAxis, ZAxis
unit_x = UnitX(Factor=1)
deconstruct_plane_2 = DeconstructPlane(Plane=horizontal_frame_3)  # -> Origin, XAxis, YAxis, ZAxis
unit_x_2 = UnitX(Factor=1)
deconstruct_plane_3 = DeconstructPlane(Plane=horizontal_frame)  # -> Origin, XAxis, YAxis, ZAxis
unit_x_3 = UnitX(Factor=1)
angle = Angle(VectorA=unit_x, VectorB=deconstruct_plane_3.XAxis)  # -> flatten(Angle), Reflex
angle_2 = Angle(VectorA=unit_x_2, VectorB=deconstruct_plane.XAxis)  # -> flatten(Angle), Reflex
angle_3 = Angle(VectorA=unit_x_3, VectorB=deconstruct_plane_2.XAxis)  # -> flatten(Angle), Reflex
list_item_2 = ListItem(List=angle.Angle, Index=0, Wrap=True)
list_item_3 = ListItem(List=angle_2.Angle, Index=0, Wrap=True)
evaluate = Evaluate(Expression="if(x=0,-y,y)", x=list_item_2, y=deconstruct_plane_3.XAxis)
evaluate_2 = Evaluate(Expression="if(x=0,-y,y)", x=list_item_3, y=deconstruct_plane.XAxis)
list_item_4 = ListItem(List=angle_3.Angle, Index=0, Wrap=True)
evaluate_3 = Evaluate(Expression="if(x=0,-y,y)", x=list_item_4, y=deconstruct_plane_2.XAxis)
line_sdl = LineSDL(Start=deconstruct_plane_3.Origin, Direction=evaluate, Length=Slider(5.5, range=2..12.5))  # -> simplify(Line)
line_sdl_2 = LineSDL(Start=deconstruct_plane.Origin, Direction=evaluate_2, Length=Slider(5.9, range=2..12.5))  # -> simplify(Line)
line_sdl_3 = LineSDL(Start=deconstruct_plane_2.Origin, Direction=evaluate_3, Length=Slider(4.7, range=2..12.5))  # -> simplify(Line)
point_on_curve = PointOnCurve(line_sdl_2, parameter=1)
point_on_curve_2 = PointOnCurve(line_sdl_3, parameter=1)
point_on_curve_3 = PointOnCurve(line_sdl, parameter=1)
point = Point(simplify(point_on_curve))
point_2 = Point(simplify(point_on_curve_3))
point_3 = Point(simplify(point_on_curve_2))
interpolate_2 = Interpolate(Vertices=[point_2, point_3, point], Degree=3, Periodic=False, KnotStyle=1)  # -> Curve, Length, Domain
join_curves = JoinCurves(Curves=[interpolate_2.Curve, interpolate.Curve, line_sdl, line_sdl_2], Preserve=False)
plane = Plane(interpolate.Curve)
number_slider = Slider(0.8, range=0.8..1.2)
surface = Surface(curve)
surface_2 = Surface(join_curves)
project = Project(Geometry=join_curves, Plane=plane)  # -> flatten(Geometry), Transform
offset_curve = OffsetCurve(Curve=rotate_3d.Geometry, Distance=expr("-x", number_slider), Plane=PlaneXY(0, 0, 0), Corners=1)  # -> flatten(Curve)
region_slits = RegionSlits(Regions=[project.Geometry, offset_curve], Width=number_slider, Gap=0)  # -> flatten(Regions), Topology; disabled
list_item_5 = ListItem(List=reverse(region_slits.Regions), Index=0, Wrap=True)
list_item_6 = ListItem(List=region_slits.Regions, Index=0, Wrap=True)
point_4 = Point([Point(-13.92128506, 84.70443108, 0), Point(-13.92128506, 112.4786591, 0)])
plane_2 = Plane([list_item_5, list_item_6])
orient = Orient(Geometry=[list_item_5, list_item_6], Source=plane_2, Target=point_4)  # -> Geometry, Transform
